# Dynamo graph Assembly Views_Creator_script.dyn (Dynamo 3.3.0.6316)
# packages: Data-Shapes 2025.3.119, SteamNodes 1.2.3, Clockwork for Dynamo 3.x 3.3.0, Crumple 2024.4.3, archi-lab.net 2018.0.6, Genius Loci 2023.7.13, Rhythm 2024.10.1

# group: Collecting Viewports
code_block = CodeBlock { "3D Views"; "All Views"; }
collect_viewporttypes = Custom[© Collect.ViewportTypes]()  # package Crumple; Returns all viewport types and their names in the provided document.
dropdown_data = Custom[DropDown Data](InputName=code_block.out1, Keys=collect_viewporttypes.names, Values=collect_viewporttypes.viewportTypes)  # package Data-Shapes; Create data for DropDown input in UI.MultiInputForm ++ . Check out www.data-shapes.net for more infos.
collect_viewporttypes_2 = Custom[© Collect.ViewportTypes]()
dropdown_data_2 = Custom[DropDown Data](InputName=code_block.out0, Keys=collect_viewporttypes_2.names, Values=collect_viewporttypes_2.viewportTypes)

# group: Collecting Title Block
string = StringInput("Select Title Block")
categories = Categories("OST_TitleBlocks")
all_family_types_of_category = Custom[All Family Types Of Category](category=categories)  # package Clockwork for Dynamo 3.x; Gets all family types/symbols of a given category in the model.
name = Element.Name(element=all_family_types_of_category)
dropdown_data_3 = Custom[DropDown Data](InputName=string, Keys=name, Values=all_family_types_of_category)

# group: Collecting Assemblies
code_block_2 = CodeBlock { "LIST OF ASSEMBLY"; 400; false; }
categories_2 = Categories("OST_Assemblies")
all_elements_of_category = ElementsOfCategory(Category=categories_2)
name_2 = Element.Name(element=all_elements_of_category)
listview_data = Custom[Listview Data](InputName=code_block_2.out0, Keys=name_2, Values=all_elements_of_category, Height_optionnal=code_block_2.out1, ShowId_optionnal=code_block_2.out2)  # package Data-Shapes; Create data for ListView input in UI.MultiInputForm ++ . Check out www.data-shapes.net for more infos.

# group: Sheet Name
code_block_3 = CodeBlock { "Enter Sheet Name"; }
textbox_data = Custom[TextBox Data](InputName=code_block_3)  # package Data-Shapes; Create Data for TextBox input in UI.MultipleInputForm ++ . Check out www.data-shapes.net for more informations

# group: Create Views
code_block_4 = CodeBlock { "CREATE ASSEMBLY VIEWS"; 900; "CANCEL"; "CREATE"; 500; 150; }
list_create = List.Create(item0=dropdown_data, item1=dropdown_data_2, item2=dropdown_data_3, item3=listview_data, item4=textbox_data)
boolean = BoolSelector(true)
multipleinputform = Custom[MultipleInputForm ++](Description_optional=code_block_4.out0, ButtonText_optional=code_block_4.out3, Inputs=list_create, Toggle=boolean, CancelButtonText_optional=code_block_4.out2, MaxHeight_optional=code_block_4.out1, Width_optional=code_block_4.out4, LabelWidth_optional=code_block_4.out5)  # package Data-Shapes; Create a form with multiple inputs. see www.data-shapes.net for tutorials and infos!
code_block_5 = CodeBlock(a=multipleinputform.User_Inputs) { a[0]; a[1]; a[2]; a[3]; a[4]; }
boolean_2 = BoolSelector(true)
boolean_3 = BoolSelector(false)
assemblyViews = Custom[Tool.AssemblyViews](assemblyList=code_block_5.out3, TitleBlockType=code_block_5.out2, CreateSheet=boolean_2, ElevationRight=boolean_3, ElevationFront=boolean_2, ElevationBack=boolean_2, PartList=boolean_2, ElevationLeft=boolean_3, ElevationTop=boolean_2, ElevationBottom=boolean_3, Ortho3D=boolean_2, PlanView=boolean_2, DetailSectionA=boolean_3, DetailSectionB=boolean_2, Ortho3D_2=boolean_2)  # package SteamNodes; Create Sheet and Views for Assembly instances

# group: Assign Assembly sheet Number and Name
code_block_6 = CodeBlock { "Sheet Number"; }
name_3 = Element.Name(element=code_block_5.out3)
setParameterByName = Element.SetParameterByName(element=assemblyViews.Sheet_s, parameterName=code_block_6, value=name_3)
code_block_7 = CodeBlock { "Sheet Name"; }
setParameterByName_2 = Element.SetParameterByName(element=assemblyViews.Sheet_s, parameterName=code_block_7, value=code_block_5.out4)

# group: 3D View Rename
string_from_object = FromObject(object=assemblyViews.List_of_View_s)
code_block_8 = CodeBlock { "3D Ortho"; }
contains = String.Contains(string=string_from_object, searchFor=code_block_8)
filterByBoolMask = List.FilterByBoolMask(list=assemblyViews.List_of_View_s, mask=contains)
flatten = List.Flatten(list=filterByBoolMask.in)
code_block_9 = CodeBlock { "View Name"; }
code_block_10 = CodeBlock { "3D VIEW-FRONT"; }
code_block_11 = CodeBlock { " - "; }
add = code_block_10 + code_block_11
name_4 = Element.Name(element=code_block_5.out3)
add_2 = add + name_4
setParameterByName_3 = Element.SetParameterByName(element=flatten, parameterName=code_block_9, value=add_2)
code_block_12 = CodeBlock { "Title on Sheet"; }
code_block_13 = CodeBlock { "3D VIEW-FRONT"; }
setParameterByName_4 = Element.SetParameterByName(element=flatten, parameterName=code_block_12, value=code_block_13)
code_block_14 = CodeBlock { "Detail Number"; }
code_block_15 = CodeBlock { "06"; }
setParameterByName_5 = Element.SetParameterByName(element=flatten, parameterName=code_block_14, value=code_block_15)

# group: 3D Rear View
string_from_object_2 = FromObject(object=assemblyViews.List_of_View_s)
code_block_16 = CodeBlock { "3D Ortho 1"; }
contains_2 = String.Contains(string=string_from_object_2, searchFor=code_block_16)
filterByBoolMask_2 = List.FilterByBoolMask(list=assemblyViews.List_of_View_s, mask=contains_2)
flatten_2 = List.Flatten(list=filterByBoolMask_2.in)
code_block_17 = CodeBlock { "View Name"; }
code_block_18 = CodeBlock { "3D VIEW-REAR"; }
code_block_19 = CodeBlock { " - "; }
add_3 = code_block_18 + code_block_19
name_5 = Element.Name(element=code_block_5.out3)
add_4 = add_3 + name_5
setParameterByName_6 = Element.SetParameterByName(element=flatten_2, parameterName=code_block_17, value=add_4)
code_block_20 = CodeBlock { "Title on Sheet"; }
code_block_21 = CodeBlock { "3D VIEW-REAR"; }
setParameterByName_7 = Element.SetParameterByName(element=flatten_2, parameterName=code_block_20, value=code_block_21)
code_block_22 = CodeBlock { "Detail Number"; }
code_block_23 = CodeBlock { "07"; }
setParameterByName_8 = Element.SetParameterByName(element=flatten_2, parameterName=code_block_22, value=code_block_23)

# group: Select View Template
code_block_24 = CodeBlock { "SELECT VIEW TEMPLATE"; 1000; "CANCEL"; "SET"; 400; 150; }
code_block_25 = CodeBlock { "Front Elevation"; }
collect_viewtemplates = Custom[© Collect.ViewTemplates]()  # package Crumple; Returns all view templates in a document. Due to API/Dynamo limitations, 3D view templates are excluded from the list.
name_6 = Element.Name(element=collect_viewtemplates.viewTemplates)
dropdown_data_4 = Custom[DropDown Data](InputName=code_block_25, Keys=name_6, Values=collect_viewtemplates.viewTemplates)
code_block_26 = CodeBlock { "Back Elevation"; }
collect_viewtemplates_2 = Custom[© Collect.ViewTemplates]()
name_7 = Element.Name(element=collect_viewtemplates_2.viewTemplates)
dropdown_data_5 = Custom[DropDown Data](InputName=code_block_26, Keys=name_7, Values=collect_viewtemplates_2.viewTemplates)
code_block_27 = CodeBlock { "Section View"; }
collect_viewtemplates_3 = Custom[© Collect.ViewTemplates]()
name_8 = Element.Name(element=collect_viewtemplates_3.viewTemplates)
dropdown_data_6 = Custom[DropDown Data](InputName=code_block_27, Keys=name_8, Values=collect_viewtemplates_3.viewTemplates)
code_block_28 = CodeBlock { "Plan Elevation"; }
collect_viewtemplates_4 = Custom[© Collect.ViewTemplates]()
name_9 = Element.Name(element=collect_viewtemplates_4.viewTemplates)
dropdown_data_7 = Custom[DropDown Data](InputName=code_block_28, Keys=name_9, Values=collect_viewtemplates_4.viewTemplates)
code_block_29 = CodeBlock { "Section Plan"; }
collect_viewtemplates_5 = Custom[© Collect.ViewTemplates]()
name_10 = Element.Name(element=collect_viewtemplates_5.viewTemplates)
dropdown_data_8 = Custom[DropDown Data](InputName=code_block_29, Keys=name_10, Values=collect_viewtemplates_5.viewTemplates)
code_block_30 = CodeBlock { "3D View"; }
collect_viewtemplates_6 = Custom[© Collect.ViewTemplates]()
name_11 = Element.Name(element=collect_viewtemplates_6.viewTemplates)
dropdown_data_9 = Custom[DropDown Data](InputName=code_block_30, Keys=name_11, Values=collect_viewtemplates_6.viewTemplates)
code_block_31 = CodeBlock { "Schedule"; }
collect_viewtemplates_7 = Custom[© Collect.ViewTemplates]()
name_12 = Element.Name(element=collect_viewtemplates_7.viewTemplates)
dropdown_data_10 = Custom[DropDown Data](InputName=code_block_31, Keys=name_12, Values=collect_viewtemplates_7.viewTemplates)
code_block_32 = CodeBlock { "Select View Type"; }
python_script = Python()  # IronPython2; unwired: IN[0]
# ---------- python_script.python (21 lines) ----------
import clr

# Import Revit API
clr.AddReference("RevitAPI")
from Autodesk.Revit.DB import *

# Import Revit Services to access the current document
clr.AddReference("RevitServices")
from RevitServices.Persistence import DocumentManager

# Get the current document
doc = DocumentManager.Instance.CurrentDBDocument

# Use FilteredElementCollector to collect all ViewFamilyTypes
collector = FilteredElementCollector(doc).OfClass(ViewFamilyType)

# Convert to list for Dynamo output
view_family_types = [v for v in collector]

# Output
OUT = view_family_types
# ----------------------------------------
name_13 = Element.Name(element=python_script)
dropdown_data_11 = Custom[DropDown Data](InputName=code_block_32, Keys=name_13, Values=python_script)
list_create_2 = List.Create(item0=dropdown_data_4, item1=dropdown_data_5, item2=dropdown_data_6, item3=dropdown_data_7, item4=dropdown_data_8, item5=dropdown_data_9, item6=dropdown_data_10, item7=dropdown_data_11)
boolean_4 = BoolSelector(true)
multipleinputform_2 = Custom[MultipleInputForm ++](Description_optional=code_block_24.out0, ButtonText_optional=code_block_24.out3, Inputs=list_create_2, Toggle=boolean_4, CancelButtonText_optional=code_block_24.out2, MaxHeight_optional=code_block_24.out1, Width_optional=code_block_24.out4, LabelWidth_optional=code_block_24.out5)
code_block_33 = CodeBlock(a=multipleinputform_2.User_Inputs) { a[0]; a[1]; a[2]; a[3]; a[4]; a[5]; a[6]; a[7]; }

# group: Elevation Front Rename
string_from_object_3 = FromObject(object=assemblyViews.List_of_View_s)
code_block_34 = CodeBlock { "Elevation Front"; }
contains_3 = String.Contains(string=string_from_object_3, searchFor=code_block_34)
filterByBoolMask_3 = List.FilterByBoolMask(list=assemblyViews.List_of_View_s, mask=contains_3)
flatten_3 = List.Flatten(list=filterByBoolMask_3.in)
code_block_35 = CodeBlock { "View Name"; }
code_block_36 = CodeBlock { "ELEVATION FRONT"; }
code_block_37 = CodeBlock { " - "; }
add_5 = code_block_36 + code_block_37
name_14 = Element.Name(element=code_block_5.out3)
add_6 = add_5 + name_14
setParameterByName_9 = Element.SetParameterByName(element=flatten_3, parameterName=code_block_35, value=add_6)
code_block_38 = CodeBlock { "Title on Sheet"; }
setParameterByName_10 = Element.SetParameterByName(element=flatten_3, parameterName=code_block_38, value=add_6)
code_block_39 = CodeBlock { "Detail Number"; }
code_block_40 = CodeBlock { "01"; }
setParameterByName_11 = Element.SetParameterByName(element=flatten_3, parameterName=code_block_39, value=code_block_40)

# group: Elevation Back Rename
string_from_object_4 = FromObject(object=assemblyViews.List_of_View_s)
code_block_41 = CodeBlock { "Elevation Back"; }
contains_4 = String.Contains(string=string_from_object_4, searchFor=code_block_41)
filterByBoolMask_4 = List.FilterByBoolMask(list=assemblyViews.List_of_View_s, mask=contains_4)
flatten_4 = List.Flatten(list=filterByBoolMask_4.in)
code_block_42 = CodeBlock { "View Name"; }
code_block_43 = CodeBlock { "ELEVATION BACK"; }
code_block_44 = CodeBlock { " - "; }
add_7 = code_block_43 + code_block_44
name_15 = Element.Name(element=code_block_5.out3)
add_8 = add_7 + name_15
setParameterByName_12 = Element.SetParameterByName(element=flatten_4, parameterName=code_block_42, value=add_8)
code_block_45 = CodeBlock { "Title on Sheet"; }
code_block_46 = CodeBlock { "ELEVATION BACK"; }
setParameterByName_13 = Element.SetParameterByName(element=flatten_4, parameterName=code_block_45, value=code_block_46)
code_block_47 = CodeBlock { "Detail Number"; }
code_block_48 = CodeBlock { "02"; }
setParameterByName_14 = Element.SetParameterByName(element=flatten_4, parameterName=code_block_47, value=code_block_48)

# group: Section Rename
string_from_object_5 = FromObject(object=assemblyViews.List_of_View_s)
code_block_49 = CodeBlock { "Section B"; }
contains_5 = String.Contains(string=string_from_object_5, searchFor=code_block_49)
filterByBoolMask_5 = List.FilterByBoolMask(list=assemblyViews.List_of_View_s, mask=contains_5)
flatten_5 = List.Flatten(list=filterByBoolMask_5.in)
code_block_50 = CodeBlock { "View Name"; }
code_block_51 = CodeBlock { "SECTION"; }
code_block_52 = CodeBlock { " - "; }
add_9 = code_block_51 + code_block_52
name_16 = Element.Name(element=code_block_5.out3)
add_10 = add_9 + name_16
setParameterByName_15 = Element.SetParameterByName(element=flatten_5, parameterName=code_block_50, value=add_10)
code_block_53 = CodeBlock { "Title on Sheet"; }
code_block_54 = CodeBlock { "SECTION"; }
setParameterByName_16 = Element.SetParameterByName(element=flatten_5, parameterName=code_block_53, value=code_block_54)
code_block_55 = CodeBlock { "Detail Number"; }
code_block_56 = CodeBlock { "03"; }
setParameterByName_17 = Element.SetParameterByName(element=flatten_5, parameterName=code_block_55, value=code_block_56)

# group: Top View Rename
string_from_object_6 = FromObject(object=assemblyViews.List_of_View_s)
code_block_57 = CodeBlock { "Elevation Top"; }
contains_6 = String.Contains(string=string_from_object_6, searchFor=code_block_57)
filterByBoolMask_6 = List.FilterByBoolMask(list=assemblyViews.List_of_View_s, mask=contains_6)
flatten_6 = List.Flatten(list=filterByBoolMask_6.in)
code_block_58 = CodeBlock { "View Name"; }
code_block_59 = CodeBlock { "TOP VIEW"; }
code_block_60 = CodeBlock { " - "; }
add_11 = code_block_59 + code_block_60
name_17 = Element.Name(element=code_block_5.out3)
add_12 = add_11 + name_17
setParameterByName_18 = Element.SetParameterByName(element=flatten_6, parameterName=code_block_58, value=add_12)
code_block_61 = CodeBlock { "Title on Sheet"; }
code_block_62 = CodeBlock { "TOP VIEW"; }
setParameterByName_19 = Element.SetParameterByName(element=flatten_6, parameterName=code_block_61, value=code_block_62)
code_block_63 = CodeBlock { "Detail Number"; }
code_block_64 = CodeBlock { "05"; }
setParameterByName_20 = Element.SetParameterByName(element=flatten_6, parameterName=code_block_63, value=code_block_64)

# group: Top View Rename
string_from_object_7 = FromObject(object=assemblyViews.List_of_View_s)
code_block_65 = CodeBlock { "Plan Detail"; }
contains_7 = String.Contains(string=string_from_object_7, searchFor=code_block_65)
filterByBoolMask_7 = List.FilterByBoolMask(list=assemblyViews.List_of_View_s, mask=contains_7)
flatten_7 = List.Flatten(list=filterByBoolMask_7.in)
code_block_66 = CodeBlock { "View Name"; }
code_block_67 = CodeBlock { "SECTION "; }
code_block_68 = CodeBlock { " - "; }
add_13 = code_block_67 + code_block_68
name_18 = Element.Name(element=code_block_5.out3)
add_14 = add_13 + name_18
setParameterByName_21 = Element.SetParameterByName(element=flatten_7, parameterName=code_block_66, value=add_14)
code_block_69 = CodeBlock { "Title on Sheet"; }
code_block_70 = CodeBlock { "SECTION"; }
setParameterByName_22 = Element.SetParameterByName(element=flatten_7, parameterName=code_block_69, value=code_block_70)
code_block_71 = CodeBlock { "Detail Number"; }
code_block_72 = CodeBlock { "04"; }
setParameterByName_23 = Element.SetParameterByName(element=flatten_7, parameterName=code_block_71, value=code_block_72)

# group: Shedule
string_from_object_8 = FromObject(object=assemblyViews.List_of_View_s)
code_block_73 = CodeBlock { "Part List"; }
contains_8 = String.Contains(string=string_from_object_8, searchFor=code_block_73)
filterByBoolMask_8 = List.FilterByBoolMask(list=assemblyViews.List_of_View_s, mask=contains_8)
flatten_8 = List.Flatten(list=filterByBoolMask_8.in)
code_block_74 = CodeBlock { "View Name"; }
name_19 = Element.Name(element=code_block_5.out3)
setParameterByName_24 = Element.SetParameterByName(element=flatten_8, parameterName=code_block_74, value=name_19)

# group: Assign View Template
list_create_3 = List.Create(item0=setParameterByName_3, item1=setParameterByName_6)
setViewTemplate = archilab.Revit.Views.View.SetViewTemplate(view=list_create_3, viewTemplate=code_block_33.out5)
setViewTemplate_2 = archilab.Revit.Views.View.SetViewTemplate(view=setParameterByName_9, viewTemplate=code_block_33.out0)
setViewTemplate_3 = archilab.Revit.Views.View.SetViewTemplate(view=setParameterByName_12, viewTemplate=code_block_33.out1)
setViewTemplate_4 = archilab.Revit.Views.View.SetViewTemplate(view=setParameterByName_15, viewTemplate=code_block_33.out2)
setViewTemplate_5 = archilab.Revit.Views.View.SetViewTemplate(view=setParameterByName_18, viewTemplate=code_block_33.out3)
setViewTemplate_6 = archilab.Revit.Views.View.SetViewTemplate(view=setParameterByName_21, viewTemplate=code_block_33.out4)
setViewTemplate_7 = archilab.Revit.Views.View.SetViewTemplate(view=setParameterByName_24, viewTemplate=code_block_33.out6)

# group: Set Viewport
transpose = List.Transpose(lists=setViewTemplate, lacing=Longest)
ʳʰʸᵗʰᵐ_view_viewport = Rhythm.Revit.Views.View.Viewport(view=transpose)
flatten_9 = List.Flatten(list=ʳʰʸᵗʰᵐ_view_viewport)
element_changetype = Custom[Element ChangeType](element=flatten_9, elementType=code_block_5.out1)  # package Genius Loci; Changes the type of the given instance to the specified type.
list_create_4 = List.Create(item0=setViewTemplate_2, item1=setViewTemplate_3, item2=setViewTemplate_4, item3=setViewTemplate_5, item4=setViewTemplate_6)
transpose_2 = List.Transpose(lists=list_create_4, lacing=Longest)
ʳʰʸᵗʰᵐ_view_viewport_2 = Rhythm.Revit.Views.View.Viewport(view=transpose_2)
flatten_10 = List.Flatten(list=ʳʰʸᵗʰᵐ_view_viewport_2)
element_changetype_2 = Custom[Element ChangeType](element=flatten_10, elementType=code_block_5.out0)
code_block_75 = CodeBlock { 0.1; }
ʳʰʸᵗʰᵐ_viewport = Rhythm.Revit.Elements.Viewport.SetViewTitleLength(viewport=element_changetype_2.SuccessElements, length=code_block_75)

# group: Views And Viewport Location
ʳʰʸᵗʰᵐ_view_viewport_3 = Rhythm.Revit.Views.View.Viewport(view=setViewTemplate_2)
code_block_76 = CodeBlock { 150; 450; }
byCoordinates = Point.ByCoordinates(x=code_block_76.out0, y=code_block_76.out1)
ʳʰʸᵗʰᵐ_viewport_setboxcenter = Rhythm.Revit.Elements.Viewport.SetBoxCenter(viewport=ʳʰʸᵗʰᵐ_view_viewport_3, point=byCoordinates)
ʳʰʸᵗʰᵐ_view_viewport_4 = Rhythm.Revit.Views.View.Viewport(view=setViewTemplate_3)
code_block_77 = CodeBlock { 300; 279; }
byCoordinates_2 = Point.ByCoordinates(x=code_block_77.out0, y=code_block_77.out1)
ʳʰʸᵗʰᵐ_viewport_setboxcenter_2 = Rhythm.Revit.Elements.Viewport.SetBoxCenter(viewport=ʳʰʸᵗʰᵐ_view_viewport_4, point=byCoordinates_2)
ʳʰʸᵗʰᵐ_view_viewport_5 = Rhythm.Revit.Views.View.Viewport(view=setViewTemplate_4)
code_block_78 = CodeBlock { 560; 279; }
byCoordinates_3 = Point.ByCoordinates(x=code_block_78.out0, y=code_block_78.out1)
ʳʰʸᵗʰᵐ_viewport_setboxcenter_3 = Rhythm.Revit.Elements.Viewport.SetBoxCenter(viewport=ʳʰʸᵗʰᵐ_view_viewport_5, point=byCoordinates_3)
ʳʰʸᵗʰᵐ_view_viewport_6 = Rhythm.Revit.Views.View.Viewport(view=setViewTemplate_5)
code_block_79 = CodeBlock { 0; 7; }
byCoordinates_4 = Point.ByCoordinates(x=code_block_79.out0, y=code_block_79.out1)
ʳʰʸᵗʰᵐ_viewport_setboxcenter_4 = Rhythm.Revit.Elements.Viewport.SetBoxCenter(viewport=ʳʰʸᵗʰᵐ_view_viewport_6, point=byCoordinates_4)
ʳʰʸᵗʰᵐ_view_viewport_7 = Rhythm.Revit.Views.View.Viewport(view=setViewTemplate_6)
code_block_80 = CodeBlock { 0; 80; }
byCoordinates_5 = Point.ByCoordinates(x=code_block_80.out0, y=code_block_80.out1)
ʳʰʸᵗʰᵐ_viewport_setboxcenter_5 = Rhythm.Revit.Elements.Viewport.SetBoxCenter(viewport=ʳʰʸᵗʰᵐ_view_viewport_7, point=byCoordinates_5)
code_block_81 = CodeBlock(A=setViewTemplate) { A[0]; A[1]; }
ʳʰʸᵗʰᵐ_view_viewport_8 = Rhythm.Revit.Views.View.Viewport(view=code_block_81.out0)
code_block_82 = CodeBlock { 330; 50; }
byCoordinates_6 = Point.ByCoordinates(x=code_block_82.out0, y=code_block_82.out1)
ʳʰʸᵗʰᵐ_viewport_setboxcenter_6 = Rhythm.Revit.Elements.Viewport.SetBoxCenter(viewport=ʳʰʸᵗʰᵐ_view_viewport_8, point=byCoordinates_6)
ʳʰʸᵗʰᵐ_view_viewport_9 = Rhythm.Revit.Views.View.Viewport(view=code_block_81.out1)
code_block_83 = CodeBlock { 600; 50; }
byCoordinates_7 = Point.ByCoordinates(x=code_block_83.out0, y=code_block_83.out1)
ʳʰʸᵗʰᵐ_viewport_setboxcenter_7 = Rhythm.Revit.Elements.Viewport.SetBoxCenter(viewport=ʳʰʸᵗʰᵐ_view_viewport_9, point=byCoordinates_7)
list_create_5 = List.Create(item0=ʳʰʸᵗʰᵐ_view_viewport_3, item1=ʳʰʸᵗʰᵐ_view_viewport_4, item2=ʳʰʸᵗʰᵐ_view_viewport_5, item3=ʳʰʸᵗʰᵐ_view_viewport_6, item4=ʳʰʸᵗʰᵐ_view_viewport_7, item5=ʳʰʸᵗʰᵐ_view_viewport_8, item6=ʳʰʸᵗʰᵐ_view_viewport_9)
end = Revit.Transaction.Transaction.End(input=list_create_5)
flatten_11 = List.Flatten(list=end)
code_block_84 = CodeBlock { 10; -20; }
byCoordinates_8 = Point.ByCoordinates(x=code_block_84.out0, y=code_block_84.out1)
ʳʰʸᵗʰᵐ_viewport_2 = Rhythm.Revit.Elements.Viewport.SetViewTitleLocation(viewport=flatten_11, location=byCoordinates_8)
schedules = Sheet.Schedules(sheet=assemblyViews.Sheet_s)
code_block_85 = CodeBlock { 600; 20; }
byCoordinates_9 = Point.ByCoordinates(x=code_block_85.out0, y=code_block_85.out1)
setLocation = ScheduleOnSheet.SetLocation(scheduleOnSheet=schedules, point=byCoordinates_9)

# group: Assign view Family Type
list_create_6 = List.Create(item0=setParameterByName_15, item1=setParameterByName_18, item2=setParameterByName_21)
code_block_86 = CodeBlock { "Type"; }
setParameterByName_25 = Element.SetParameterByName(element=list_create_6, parameterName=code_block_86, value=code_block_33.out7)
