# Dynamo graph Export NWC_script.dyn "Export NWC" (Dynamo 3.3.0.6316)
# packages: Data-Shapes 2025.3.119

code_block = CodeBlock { "Export NWC"; 500; "NWC File"; }
code_block_2 = CodeBlock { "Select Views"; }
categories = Categories("OST_Views")
all_elements_of_category = ElementsOfCategory(Category=categories)
name = Element.Name(element=all_elements_of_category)
dropdown_data = Custom[DropDown Data](InputName=code_block_2, Keys=name, Values=all_elements_of_category)  # package Data-Shapes; Create data for DropDown input in UI.MultiInputForm ++ . Check out www.data-shapes.net for more infos.
code_block_3 = CodeBlock { "Select NWC Path"; }
directorypath_data = Custom[DirectoryPath Data](InputName=code_block_3)  # package Data-Shapes; Creates a DirectoryPath input for UI.MultipleInputForm ++ . Check out www.data-shapes.net for more infos!
code_block_4 = CodeBlock { "NWC File Name"; }
textbox_data = Custom[TextBox Data](InputName=code_block_4)  # package Data-Shapes; Create Data for TextBox input in UI.MultipleInputForm ++ . Check out www.data-shapes.net for more informations
list_create = List.Create(item0=dropdown_data, item1=directorypath_data, item2=textbox_data)
boolean = BoolSelector(true)
multipleinputform = Custom[MultipleInputForm ++](Description_optional=code_block.out0, Logo_optional=code_block.out2, Inputs=list_create, Toggle=boolean, MaxHeight_optional=code_block.out1)  # package Data-Shapes; Create a form with multiple inputs. see www.data-shapes.net for tutorials and infos!
code_block_5 = CodeBlock(a=multipleinputform.User_Inputs) { a[0]; a[1]; a[2]; }
python_script = Python(IN[0]=code_block_5.out0, IN[1]=code_block_5.out1, IN[2]=code_block_5.out2)  # IronPython2
# ---------- python_script.python (37 lines) ----------
import clr
clr.AddReference('RevitServices')
from RevitServices.Persistence import DocumentManager

clr.AddReference('RevitAPI')
from Autodesk.Revit.DB import *

# Get document
doc = DocumentManager.Instance.CurrentDBDocument

# Inputs
views = UnwrapElement(IN[0])   # 3D views or list of views
folder = IN[1]                 # Output folder (string)
filename = IN[2]               # File name (string)

# Ensure input is a list
if not isinstance(views, list):
    views = [views]

exported = []

for v in views:
    try:
        # Navisworks export setup
        options = NavisworksExportOptions()
        options.ExportScope = NavisworksExportScope.View
        options.ViewId = v.Id
        options.ExportLinks = True
        options.ConvertElementProperties = True
        
        # Export
        doc.Export(folder, filename, options)
        exported.append("Exported: " + filename + ".nwc")
    except Exception as e:
        exported.append("Failed: " + str(e))

OUT = exported
# ----------------------------------------
