# Dynamo graph Shop Drawing_script.dyn (Dynamo 3.3.0.6316)
# packages: Crumple 2024.4.3, Data-Shapes 2025.3.119, Clockwork for Dynamo 3.x 3.3.0

# group: Inputs all Sheets
code_block = CodeBlock { "SELECT VIEWSET"; 800; }
collect_viewsheetsets = Custom[© Collect.ViewSheetSets]()  # package Crumple; Returns all view sheet sets in the target document.
name = Element.Name(element=collect_viewsheetsets)
dropdown_data = Custom[DropDown Data](InputName=code_block.out0, Keys=name, Values=collect_viewsheetsets)  # package Data-Shapes; Create data for DropDown input in UI.MultiInputForm ++ . Check out www.data-shapes.net for more infos.

# group: DWG&PDF Path
code_block_2 = CodeBlock { "SELECT DWG PATH"; "SELECT PDF PATH"; "Select PDF...."; "Select DWG...."; "SELECT DWG SETTINGS"; "DWG FILE"; }
directorypath_data = Custom[DirectoryPath Data](InputName=code_block_2.out1, ButtonText=code_block_2.out2)  # package Data-Shapes; Creates a DirectoryPath input for UI.MultipleInputForm ++ . Check out www.data-shapes.net for more infos!
directorypath_data_2 = Custom[DirectoryPath Data](InputName=code_block_2.out0, ButtonText=code_block_2.out3)
boolean_input = Custom[Boolean input](InputName=code_block_2.out5)  # package Data-Shapes; Creates a boolean input for UI.MultipleInputForm ++ . Check out www.data-shapes.net for more infos!
collect_baseexportoptions = Custom[© Collect.BaseExportOptions]()  # package Crumple; Collect the DWG/DXF/DGN options from the provided document if any, returning their name.
dropdown_data_2 = Custom[DropDown Data](InputName=code_block_2.out4, Keys=collect_baseexportoptions, Values=collect_baseexportoptions)

# group: UI
code_block_3 = CodeBlock { "EXPORT SHOP DRAWINGS"; "CANCEL"; "CREATE"; 800; 160; 500; }
list_create = List.Create(item0=dropdown_data, item1=directorypath_data, item2=directorypath_data_2, item3=boolean_input, item4=dropdown_data_2)
boolean = BoolSelector(true)
multipleinputform = Custom[MultipleInputForm ++](Description_optional=code_block_3.out0, ButtonText_optional=code_block_3.out2, Inputs=list_create, Toggle=boolean, CancelButtonText_optional=code_block_3.out1, MaxHeight_optional=code_block_3.out3, Width_optional=code_block_3.out5, LabelWidth_optional=code_block_3.out4)  # package Data-Shapes; Create a form with multiple inputs. see www.data-shapes.net for tutorials and infos!
code_block_4 = CodeBlock(out=multipleinputform.User_Inputs) { views = out[0]; pdf = out[1]; dwg = out[2]; bo = out[3]; dwgs = out[4]; }

# group: Parameter Values
viewsheetsets_views = Custom[© ViewSheetSets.Views](viewSheetSet=code_block_4.views)  # package Crumple; Return all views and sheets in the view sheet set(s).
flatten = List.Flatten(list=viewsheetsets_views)
code_block_5 = CodeBlock()
# ---------- code_block_5.designscript (7 lines) ----------
"Sh.02.Work Package";
"Sh.03.Originator";
"Sh.04.Area";
"Sh.05.Building Work";
"Sh.06.Level";
"Sh.07.File Type";
"Sh.08.Discipline";
# ----------------------------------------
getParameterValueByName = Element.GetParameterValueByName(element=flatten, parameterName=code_block_5.out0)
getParameterValueByName_2 = Element.GetParameterValueByName(element=flatten, parameterName=code_block_5.out1)
getParameterValueByName_3 = Element.GetParameterValueByName(element=flatten, parameterName=code_block_5.out2)
getParameterValueByName_4 = Element.GetParameterValueByName(element=flatten, parameterName=code_block_5.out3)
getParameterValueByName_5 = Element.GetParameterValueByName(element=flatten, parameterName=code_block_5.out4)
getParameterValueByName_6 = Element.GetParameterValueByName(element=flatten, parameterName=code_block_5.out5)
getParameterValueByName_7 = Element.GetParameterValueByName(element=flatten, parameterName=code_block_5.out6)
sheetNumber = Sheet.SheetNumber(sheet=flatten)
sheetName = Sheet.SheetName(sheet=flatten)
list_create_2 = List.Create(item0=getParameterValueByName, item1=getParameterValueByName_2, item2=getParameterValueByName_3, item3=getParameterValueByName_4, item4=getParameterValueByName_5, item5=getParameterValueByName_6, item6=getParameterValueByName_7, item7=sheetNumber, item8=sheetName)

# group: Adding Project Number
projectParameters = Custom[Document.ProjectParameters]()  # package Clockwork for Dynamo 3.x; Retrieves all project parameters and the categories they have been assigned to
string_from_object = FromObject(object=projectParameters.paramName)
code_block_6 = CodeBlock { "Sh.01.Project Code"; }
contains = String.Contains(string=string_from_object, searchFor=code_block_6)
filterByBoolMask = List.FilterByBoolMask(list=projectParameters.paramName, mask=contains)
parameters_projectinformation = Custom[© Parameters.ProjectInformation](params=filterByBoolMask.in)  # package Crumple; Retrieve project information field(s) by name.
code_block_7 = CodeBlock { "-"; }
transpose = List.Transpose(lists=list_create_2)
join = String.Join(separator=code_block_7, string0=transpose, lacing=Longest)
code_block_8 = CodeBlock(a=parameters_projectinformation, b=join) { a+"-"+b; }

# group: PDF & DWG Export
flatten_2 = List.Flatten(list=code_block_8)
boolean_2 = BoolSelector(true)
revit_exportoptionspdf = Custom[© Revit.ExportOptionsPdf](hideCrop=boolean_2, hideScopeBoxes=boolean_2, hideRefPlanes=boolean_2, hideUnreferenced=boolean_2, maskCoincident=boolean_2)  # package Crumple; Provides a list of options to be used in conjunction with the ExportPDF node. Works in Revit 2022 and later.
revit_exporttopdf = Custom[© Revit.ExportToPdf](directoryPath=code_block_4.pdf, sheets=flatten, fileNames=flatten_2, options=revit_exportoptionspdf)  # package Crumple; Given a list of sheets, names, directory and export options this node will batch export PDF files. Requires Revit 2022 or higher to work.
revit_exportoptionsdwg = Custom[© Revit.ExportOptionsDwg](settingsName=code_block_4.dwgs)  # package Crumple; Creates a DWG export options object, or retrieves one with the given name if found in the document.
revit_exporttodwg = Custom[© Revit.ExportToDwg](directoryPath=code_block_4.dwg, viewsOrSheets=flatten, fileNames=flatten_2, dwgExportOptions=revit_exportoptionsdwg.dwgExportOptions, runMe=code_block_4.bo)  # package Crumple; Given a list of views and/or sheets as well as various related settings, attempts to export them to DWG using the provided settings.
