# Dynamo graph Assembly Views_Creator_script.dyn (Dynamo 3.3.0.6316)
# packages: Data-Shapes 2025.3.119, SteamNodes 1.2.3, Clockwork for Dynamo 3.x 3.3.0, Crumple 2024.4.3, Genius Loci 2023.7.13, Rhythm 2024.10.1, archi-lab.net 2025.300.1225, Data-Shapes 2026.4.0

# group: Collecting Viewports
code_block = CodeBlock { "3D Views"; "All Views"; 3; 1; }
collect_viewporttypes = Custom[© Collect.ViewportTypes]()  # package Crumple; Returns all viewport types and their names in the provided document.
dropdown_data = Custom[DropDown Data](InputName=code_block.out1, Keys=collect_viewporttypes.names, Values=collect_viewporttypes.viewportTypes, DefaultValueIndex=code_block.out2)  # package Data-Shapes; Create data for DropDown input in UI.MultiInputForm ++ . Check out www.data-shapes.net for more infos.
collect_viewporttypes_2 = Custom[© Collect.ViewportTypes]()
dropdown_data_2 = Custom[DropDown Data](InputName=code_block.out0, Keys=collect_viewporttypes_2.names, Values=collect_viewporttypes_2.viewportTypes, DefaultValueIndex=code_block.out3)

# group: Collecting Title Block
string = StringInput("Select Title Block")
categories = Categories("OST_TitleBlocks")
all_family_types_of_category = Custom[All Family Types Of Category](category=categories)  # package Clockwork for Dynamo 3.x; Gets all family types/symbols of a given category in the model.
name = Element.Name(element=all_family_types_of_category)
code_block_2 = CodeBlock { 2; }
dropdown_data_3 = Custom[DropDown Data](InputName=string, Keys=name, Values=all_family_types_of_category, DefaultValueIndex=code_block_2)

# group: Collecting Assemblies
code_block_3 = CodeBlock { "LIST OF ASSEMBLY"; 300; false; }
categories_2 = Categories("OST_Assemblies")
all_elements_of_category = ElementsOfCategory(Category=categories_2)
name_2 = Element.Name(element=all_elements_of_category)
listview_data = Custom[Listview Data](InputName=code_block_3.out0, Keys=name_2, Values=all_elements_of_category, Height_optionnal=code_block_3.out1, ShowId_optionnal=code_block_3.out2)  # package Data-Shapes; Create data for ListView input in UI.MultiInputForm ++ . Check out www.data-shapes.net for more infos.

# group: Sheet Name
code_block_4 = CodeBlock { "Enter Sheet Name"; "FABRICATION DRAWING FOR PRECAST GROUND/FIRST/ROOF FLOOR PANEL"; }
textbox_data = Custom[TextBox Data](InputName=code_block_4.out0, DefaultText=code_block_4.out1)  # package Data-Shapes; Create Data for TextBox input in UI.MultipleInputForm ++ . Check out www.data-shapes.net for more informations

# group: Create Views
code_block_5 = CodeBlock { "CREATE ASSEMBLY VIEWS"; 800; "CANCEL"; "CREATE"; 450; 100; }
list_create = List.Create(item0=dropdown_data, item1=dropdown_data_2, item2=dropdown_data_3, item3=listview_data, item4=textbox_data)
boolean = BoolSelector(true)
multipleinputform = Custom[MultipleInputForm ++](Description_optional=code_block_5.out0, ButtonText_optional=code_block_5.out3, Inputs=list_create, Toggle=boolean, CancelButtonText_optional=code_block_5.out2, MaxHeight_optional=code_block_5.out1, Width_optional=code_block_5.out4, LabelWidth_optional=code_block_5.out5)  # package Data-Shapes; Create a form with multiple inputs. see www.data-shapes.net for tutorials and infos!
code_block_6 = CodeBlock(a=multipleinputform.User_Inputs) { a[0]; a[1]; a[2]; a[3]; a[4]; }
boolean_2 = BoolSelector(true)
boolean_3 = BoolSelector(false)
assemblyViews = Custom[Tool.AssemblyViews](AssemblyList=code_block_6.out3, TitleBlockType=code_block_6.out2, CreateSheet=boolean_2, ElevationRight=boolean_3, ElevationFront=boolean_2, ElevationBack=boolean_2, PartList=boolean_2, ElevationLeft=boolean_3, ElevationTop=boolean_2, ElevationBottom=boolean_3, Ortho3D=boolean_2, PlanView=boolean_2, DetailSectionA=boolean_3, DetailSectionB=boolean_2, Ortho3D_2=boolean_2)  # package SteamNodes; Create Sheet and Views for Assembly instances

# group: Assign Assembly sheet Number and Name
code_block_7 = CodeBlock { "Sheet Number"; }
name_3 = Element.Name(element=code_block_6.out3)
setParameterByName = Element.SetParameterByName(element=assemblyViews.Sheet_s, parameterName=code_block_7, value=name_3)
code_block_8 = CodeBlock { "Sheet Name"; }
setParameterByName_2 = Element.SetParameterByName(element=assemblyViews.Sheet_s, parameterName=code_block_8, value=code_block_6.out4)

# group: Elevation Front Rename
string_from_object = FromObject(object=assemblyViews.List_of_View_s)
code_block_9 = CodeBlock { "Elevation Front"; }
contains = String.Contains(string=string_from_object, searchFor=code_block_9)
filterByBoolMask = List.FilterByBoolMask(list=assemblyViews.List_of_View_s, mask=contains)
flatten = List.Flatten(list=filterByBoolMask.in)
code_block_10 = CodeBlock { "View Name"; }
code_block_11 = CodeBlock { "ELEVATION FRONT"; }
code_block_12 = CodeBlock { " - "; }
add = code_block_11 + code_block_12
name_4 = Element.Name(element=code_block_6.out3)
add_2 = add + name_4
setParameterByName_3 = Element.SetParameterByName(element=flatten, parameterName=code_block_10, value=add_2)
code_block_13 = CodeBlock { "Title on Sheet"; }
setParameterByName_4 = Element.SetParameterByName(element=flatten, parameterName=code_block_13, value=add_2)
code_block_14 = CodeBlock { "Detail Number"; }
code_block_15 = CodeBlock { "01"; }
setParameterByName_5 = Element.SetParameterByName(element=flatten, parameterName=code_block_14, value=code_block_15)

# group: Select View Template
code_block_16 = CodeBlock { "SELECT VIEW TEMPLATE"; 1000; "CANCEL"; "SET"; 400; 150; }
code_block_17 = CodeBlock { "Front Elevation"; 14; }
collect_viewtemplates = Custom[© Collect.ViewTemplates]()  # package Crumple; Returns all view templates in a document. Due to API/Dynamo limitations, 3D view templates are excluded from the list.
name_5 = Element.Name(element=collect_viewtemplates.viewTemplates)
dropdown_data_4 = Custom[DropDown Data](InputName=code_block_17.out0, Keys=name_5, Values=collect_viewtemplates.viewTemplates, DefaultValueIndex=code_block_17.out1)
code_block_18 = CodeBlock { "Back Elevation"; 12; }
collect_viewtemplates_2 = Custom[© Collect.ViewTemplates]()
name_6 = Element.Name(element=collect_viewtemplates_2.viewTemplates)
dropdown_data_5 = Custom[DropDown Data](InputName=code_block_18.out0, Keys=name_6, Values=collect_viewtemplates_2.viewTemplates, DefaultValueIndex=code_block_18.out1)
code_block_19 = CodeBlock { "Section View"; 17; }
collect_viewtemplates_3 = Custom[© Collect.ViewTemplates]()
name_7 = Element.Name(element=collect_viewtemplates_3.viewTemplates)
dropdown_data_6 = Custom[DropDown Data](InputName=code_block_19.out0, Keys=name_7, Values=collect_viewtemplates_3.viewTemplates, DefaultValueIndex=code_block_19.out1)
code_block_20 = CodeBlock { "Plan Elevation"; 16; }
collect_viewtemplates_4 = Custom[© Collect.ViewTemplates]()
name_8 = Element.Name(element=collect_viewtemplates_4.viewTemplates)
dropdown_data_7 = Custom[DropDown Data](InputName=code_block_20.out0, Keys=name_8, Values=collect_viewtemplates_4.viewTemplates, DefaultValueIndex=code_block_20.out1)
code_block_21 = CodeBlock { "Section Plan"; 19; }
collect_viewtemplates_5 = Custom[© Collect.ViewTemplates]()
name_9 = Element.Name(element=collect_viewtemplates_5.viewTemplates)
dropdown_data_8 = Custom[DropDown Data](InputName=code_block_21.out0, Keys=name_9, Values=collect_viewtemplates_5.viewTemplates, DefaultValueIndex=code_block_21.out1)
code_block_22 = CodeBlock { "3D View"; 17; }
collect_viewtemplates_6 = Custom[© Collect.ViewTemplates]()
name_10 = Element.Name(element=collect_viewtemplates_6.viewTemplates)
dropdown_data_9 = Custom[DropDown Data](InputName=code_block_22.out0, Keys=name_10, Values=collect_viewtemplates_6.viewTemplates, DefaultValueIndex=code_block_22.out1)
code_block_23 = CodeBlock { "Schedule"; 8; }
collect_viewtemplates_7 = Custom[© Collect.ViewTemplates]()
name_11 = Element.Name(element=collect_viewtemplates_7.viewTemplates)
dropdown_data_10 = Custom[DropDown Data](InputName=code_block_23.out0, Keys=name_11, Values=collect_viewtemplates_7.viewTemplates, DefaultValueIndex=code_block_23.out1)
code_block_24 = CodeBlock { "Select View Type"; 8; }
python_script = Python()  # IronPython2; unwired: IN[0]
# ---------- python_script.python (21 lines) ----------
import clr

# Import Revit API
clr.AddReference("RevitAPI")
from Autodesk.Revit.DB import *

# Import Revit Services to access the current document
clr.AddReference("RevitServices")
from RevitServices.Persistence import DocumentManager

# Get the current document
doc = DocumentManager.Instance.CurrentDBDocument

# Use FilteredElementCollector to collect all ViewFamilyTypes
collector = FilteredElementCollector(doc).OfClass(ViewFamilyType)

# Convert to list for Dynamo output
view_family_types = [v for v in collector]

# Output
OUT = view_family_types
# ----------------------------------------
name_12 = Element.Name(element=python_script)
dropdown_data_11 = Custom[DropDown Data](InputName=code_block_24.out0, Keys=name_12, Values=python_script, DefaultValueIndex=code_block_24.out1)
list_create_2 = List.Create(item0=dropdown_data_4, item1=dropdown_data_5, item2=dropdown_data_6, item3=dropdown_data_7, item4=dropdown_data_8, item5=dropdown_data_9, item6=dropdown_data_10, item7=dropdown_data_11)
boolean_4 = BoolSelector(true)
multipleinputform_2 = Custom[MultipleInputForm ++](Description_optional=code_block_16.out0, ButtonText_optional=code_block_16.out3, Inputs=list_create_2, Toggle=boolean_4, CancelButtonText_optional=code_block_16.out2, MaxHeight_optional=code_block_16.out1, Width_optional=code_block_16.out4, LabelWidth_optional=code_block_16.out5)
code_block_25 = CodeBlock(a=multipleinputform_2.User_Inputs) { a[0]; a[1]; a[2]; a[3]; a[4]; a[5]; a[6]; a[7]; }

# group: Elevation Back Rename
string_from_object_2 = FromObject(object=assemblyViews.List_of_View_s)
code_block_26 = CodeBlock { "Elevation Back"; }
contains_2 = String.Contains(string=string_from_object_2, searchFor=code_block_26)
filterByBoolMask_2 = List.FilterByBoolMask(list=assemblyViews.List_of_View_s, mask=contains_2)
flatten_2 = List.Flatten(list=filterByBoolMask_2.in)
code_block_27 = CodeBlock { "View Name"; }
code_block_28 = CodeBlock { "ELEVATION BACK"; }
code_block_29 = CodeBlock { " - "; }
add_3 = code_block_28 + code_block_29
name_13 = Element.Name(element=code_block_6.out3)
add_4 = add_3 + name_13
setParameterByName_6 = Element.SetParameterByName(element=flatten_2, parameterName=code_block_27, value=add_4)
code_block_30 = CodeBlock { "Title on Sheet"; }
code_block_31 = CodeBlock { "ELEVATION BACK"; }
setParameterByName_7 = Element.SetParameterByName(element=flatten_2, parameterName=code_block_30, value=code_block_31)
code_block_32 = CodeBlock { "Detail Number"; }
code_block_33 = CodeBlock { "02"; }
setParameterByName_8 = Element.SetParameterByName(element=flatten_2, parameterName=code_block_32, value=code_block_33)

# group: Section Rename
string_from_object_3 = FromObject(object=assemblyViews.List_of_View_s)
code_block_34 = CodeBlock { "Section B"; }
contains_3 = String.Contains(string=string_from_object_3, searchFor=code_block_34)
filterByBoolMask_3 = List.FilterByBoolMask(list=assemblyViews.List_of_View_s, mask=contains_3)
flatten_3 = List.Flatten(list=filterByBoolMask_3.in)
code_block_35 = CodeBlock { "View Name"; }
code_block_36 = CodeBlock { "SECTION"; }
code_block_37 = CodeBlock { " - "; }
add_5 = code_block_36 + code_block_37
name_14 = Element.Name(element=code_block_6.out3)
add_6 = add_5 + name_14
setParameterByName_9 = Element.SetParameterByName(element=flatten_3, parameterName=code_block_35, value=add_6)
code_block_38 = CodeBlock { "Title on Sheet"; }
code_block_39 = CodeBlock { "SECTION"; }
setParameterByName_10 = Element.SetParameterByName(element=flatten_3, parameterName=code_block_38, value=code_block_39)
code_block_40 = CodeBlock { "Detail Number"; }
code_block_41 = CodeBlock { "03"; }
setParameterByName_11 = Element.SetParameterByName(element=flatten_3, parameterName=code_block_40, value=code_block_41)

# group: Top View Rename
string_from_object_4 = FromObject(object=assemblyViews.List_of_View_s)
code_block_42 = CodeBlock { "Elevation Top"; }
contains_4 = String.Contains(string=string_from_object_4, searchFor=code_block_42)
filterByBoolMask_4 = List.FilterByBoolMask(list=assemblyViews.List_of_View_s, mask=contains_4)
flatten_4 = List.Flatten(list=filterByBoolMask_4.in)
code_block_43 = CodeBlock { "View Name"; }
code_block_44 = CodeBlock { "TOP VIEW"; }
code_block_45 = CodeBlock { " - "; }
add_7 = code_block_44 + code_block_45
name_15 = Element.Name(element=code_block_6.out3)
add_8 = add_7 + name_15
setParameterByName_12 = Element.SetParameterByName(element=flatten_4, parameterName=code_block_43, value=add_8)
code_block_46 = CodeBlock { "Title on Sheet"; }
code_block_47 = CodeBlock { "TOP VIEW"; }
setParameterByName_13 = Element.SetParameterByName(element=flatten_4, parameterName=code_block_46, value=code_block_47)
code_block_48 = CodeBlock { "Detail Number"; }
code_block_49 = CodeBlock { "05"; }
setParameterByName_14 = Element.SetParameterByName(element=flatten_4, parameterName=code_block_48, value=code_block_49)

# group: Top View Rename
string_from_object_5 = FromObject(object=assemblyViews.List_of_View_s)
code_block_50 = CodeBlock { "Plan Detail"; }
contains_5 = String.Contains(string=string_from_object_5, searchFor=code_block_50)
filterByBoolMask_5 = List.FilterByBoolMask(list=assemblyViews.List_of_View_s, mask=contains_5)
flatten_5 = List.Flatten(list=filterByBoolMask_5.in)
code_block_51 = CodeBlock { "View Name"; }
code_block_52 = CodeBlock { "SECTION "; }
code_block_53 = CodeBlock { " - "; }
add_9 = code_block_52 + code_block_53
name_16 = Element.Name(element=code_block_6.out3)
add_10 = add_9 + name_16
setParameterByName_15 = Element.SetParameterByName(element=flatten_5, parameterName=code_block_51, value=add_10)
code_block_54 = CodeBlock { "Title on Sheet"; }
code_block_55 = CodeBlock { "SECTION"; }
setParameterByName_16 = Element.SetParameterByName(element=flatten_5, parameterName=code_block_54, value=code_block_55)
code_block_56 = CodeBlock { "Detail Number"; }
code_block_57 = CodeBlock { "04"; }
setParameterByName_17 = Element.SetParameterByName(element=flatten_5, parameterName=code_block_56, value=code_block_57)

# group: 3D View Rename
string_from_object_6 = FromObject(object=assemblyViews.List_of_View_s)
code_block_58 = CodeBlock { "3D Ortho"; }
contains_6 = String.Contains(string=string_from_object_6, searchFor=code_block_58)
filterByBoolMask_6 = List.FilterByBoolMask(list=assemblyViews.List_of_View_s, mask=contains_6)
flatten_6 = List.Flatten(list=filterByBoolMask_6.in)
code_block_59 = CodeBlock { "View Name"; }
code_block_60 = CodeBlock { "3D VIEW-FRONT"; }
code_block_61 = CodeBlock { " - "; }
add_11 = code_block_60 + code_block_61
name_17 = Element.Name(element=code_block_6.out3)
add_12 = add_11 + name_17
setParameterByName_18 = Element.SetParameterByName(element=flatten_6, parameterName=code_block_59, value=add_12)
code_block_62 = CodeBlock { "Title on Sheet"; }
code_block_63 = CodeBlock { "3D VIEW-FRONT"; }
setParameterByName_19 = Element.SetParameterByName(element=flatten_6, parameterName=code_block_62, value=code_block_63)
code_block_64 = CodeBlock { "Detail Number"; }
code_block_65 = CodeBlock { "06"; }
setParameterByName_20 = Element.SetParameterByName(element=flatten_6, parameterName=code_block_64, value=code_block_65)
boolean_5 = BoolSelector(false)
n3dview_lock_or_unlock = Custom[3DView Lock or Unlock](ThreeDView=setParameterByName_18, Toggle=boolean_5)  # package Genius Loci; Use a boolean True to unlock the 3D view. False locks the 3D view and saves its orientation. (The default 3D view aka {3D} must be renamed to be saved)

# group: 3D Rear View
string_from_object_7 = FromObject(object=assemblyViews.List_of_View_s)
code_block_66 = CodeBlock { "3D Ortho 1"; }
contains_7 = String.Contains(string=string_from_object_7, searchFor=code_block_66)
filterByBoolMask_7 = List.FilterByBoolMask(list=assemblyViews.List_of_View_s, mask=contains_7)
flatten_7 = List.Flatten(list=filterByBoolMask_7.in)
code_block_67 = CodeBlock { "View Name"; }
code_block_68 = CodeBlock { "3D VIEW-REAR"; }
code_block_69 = CodeBlock { " - "; }
add_13 = code_block_68 + code_block_69
name_18 = Element.Name(element=code_block_6.out3)
add_14 = add_13 + name_18
setParameterByName_21 = Element.SetParameterByName(element=flatten_7, parameterName=code_block_67, value=add_14)
code_block_70 = CodeBlock { "Title on Sheet"; }
code_block_71 = CodeBlock { "3D VIEW-REAR"; }
setParameterByName_22 = Element.SetParameterByName(element=flatten_7, parameterName=code_block_70, value=code_block_71)
code_block_72 = CodeBlock { "Detail Number"; }
code_block_73 = CodeBlock { "07"; }
setParameterByName_23 = Element.SetParameterByName(element=flatten_7, parameterName=code_block_72, value=code_block_73)

python_script_2 = Python(IN[0]=setParameterByName_21)  # CPython3
# ---------- python_script_2.python (137 lines) ----------
# FLIP MULTIPLE 3D VIEWS - Processes all views in the list

import clr
clr.AddReference('RevitAPI')
clr.AddReference('RevitServices')
from Autodesk.Revit.DB import *
from RevitServices.Persistence import DocumentManager
from RevitServices.Transactions import TransactionManager
import math

doc = DocumentManager.Instance.CurrentDBDocument

# Get input - handle both single view and list of views
input_data = IN[0]

# Ensure it's a list
if not isinstance(input_data, list):
    view_list = [input_data]
else:
    view_list = input_data

def flip_single_view(view):
    """
    Flips a single 3D view horizontally
    Returns: (success, view_element)
    """
    try:
        # Unwrap element
        view = UnwrapElement(view)
        
        # Validate it's a 3D View
        if not isinstance(view, View3D):
            return False, None
        
        # Get current orientation
        orient = view.GetOrientation()
        eye = orient.EyePosition
        up = orient.UpDirection
        fwd = orient.ForwardDirection
        
        # Get bounding box
        bbox = view.CropBox
        
        # Calculate horizontal component
        fwd_horizontal = XYZ(fwd.X, fwd.Y, 0)
        fwd_h_len = math.sqrt(fwd_horizontal.X**2 + fwd_horizontal.Y**2)
        
        if fwd_h_len > 0.001:
            fwd_h_norm = XYZ(fwd_horizontal.X/fwd_h_len, fwd_horizontal.Y/fwd_h_len, 0)
            new_fwd_h = XYZ(-fwd_h_norm.X, -fwd_h_norm.Y, 0)
            new_fwd = XYZ(new_fwd_h.X * fwd_h_len, new_fwd_h.Y * fwd_h_len, fwd.Z)
            
            new_fwd_len = math.sqrt(new_fwd.X**2 + new_fwd.Y**2 + new_fwd.Z**2)
            if new_fwd_len > 0.001:
                new_fwd = XYZ(new_fwd.X/new_fwd_len, new_fwd.Y/new_fwd_len, new_fwd.Z/new_fwd_len)
        else:
            new_fwd = XYZ(-fwd.X, -fwd.Y, -fwd.Z)
        
        new_up = up
        
        # Ensure perpendicularity
        dot = new_fwd.X * new_up.X + new_fwd.Y * new_up.Y + new_fwd.Z * new_up.Z
        
        if abs(dot) > 0.01:
            right = XYZ(new_fwd.Y * new_up.Z - new_fwd.Z * new_up.Y,
                       new_fwd.Z * new_up.X - new_fwd.X * new_up.Z,
                       new_fwd.X * new_up.Y - new_fwd.Y * new_up.X)
            
            r_len = math.sqrt(right.X**2 + right.Y**2 + right.Z**2)
            if r_len > 0.001:
                right = XYZ(right.X/r_len, right.Y/r_len, right.Z/r_len)
                
                new_up = XYZ(right.Y * new_fwd.Z - right.Z * new_fwd.Y,
                            right.Z * new_fwd.X - right.X * new_fwd.Z,
                            right.X * new_fwd.Y - right.Y * new_fwd.X)
                
                u_len = math.sqrt(new_up.X**2 + new_up.Y**2 + new_up.Z**2)
                if u_len > 0.001:
                    new_up = XYZ(new_up.X/u_len, new_up.Y/u_len, new_up.Z/u_len)
        
        # Calculate new eye position to keep view centered
        if bbox:
            bbox_transform = bbox.Transform
            bbox_center = bbox_transform.Origin
            
            distance = math.sqrt((eye.X - bbox_center.X)**2 + 
                               (eye.Y - bbox_center.Y)**2 + 
                               (eye.Z - bbox_center.Z)**2)
            
            new_eye = XYZ(bbox_center.X - new_fwd.X * distance,
                         bbox_center.Y - new_fwd.Y * distance,
                         bbox_center.Z - new_fwd.Z * distance)
        else:
            new_eye = eye
        
        # Apply new orientation
        new_orient = ViewOrientation3D(new_eye, new_up, new_fwd)
        view.SetOrientation(new_orient)
        
        # Disable temporary view mode
        try:
            temp_param = view.get_Parameter(BuiltInParameter.VIEWER_TEMPORARY_VIEW_MODE)
            if temp_param and not temp_param.IsReadOnly:
                temp_param.Set(0)
        except:
            pass
        
        # Save and lock
        try:
            view.SaveOrientationAndLock()
        except:
            pass
        
        return True, view
        
    except Exception as e:
        return False, None

# Process all views
flipped_views = []

# Start transaction once for all views
TransactionManager.Instance.EnsureInTransaction(doc)

for view_item in view_list:
    success, view = flip_single_view(view_item)
    
    if success and view is not None:
        flipped_views.append(view)

# Regenerate once after all changes
doc.Regenerate()

# End transaction
TransactionManager.Instance.TransactionTaskDone()

OUT = flipped_views
# ----------------------------------------

# group: Assign view Family Type
list_create_3 = List.Create(item0=setParameterByName_9, item1=setParameterByName_12, item2=setParameterByName_15)
code_block_74 = CodeBlock { "Type"; }
setParameterByName_24 = Element.SetParameterByName(element=list_create_3, parameterName=code_block_74, value=code_block_25.out7)

# group: Shedule
string_from_object_8 = FromObject(object=assemblyViews.List_of_View_s)
code_block_75 = CodeBlock { "Part List"; }
contains_8 = String.Contains(string=string_from_object_8, searchFor=code_block_75)
filterByBoolMask_8 = List.FilterByBoolMask(list=assemblyViews.List_of_View_s, mask=contains_8)
flatten_8 = List.Flatten(list=filterByBoolMask_8.in)
code_block_76 = CodeBlock { "View Name"; }
name_19 = Element.Name(element=code_block_6.out3)
setParameterByName_25 = Element.SetParameterByName(element=flatten_8, parameterName=code_block_76, value=name_19)

# group: Assign View Template
setViewTemplate = archilab.Revit.Views.Views.SetViewTemplate(view=setParameterByName_3, viewTemplate=code_block_25.out0)
setViewTemplate_2 = archilab.Revit.Views.Views.SetViewTemplate(view=setParameterByName_6, viewTemplate=code_block_25.out1)
setViewTemplate_3 = archilab.Revit.Views.Views.SetViewTemplate(view=setParameterByName_9, viewTemplate=code_block_25.out2)
setViewTemplate_4 = archilab.Revit.Views.Views.SetViewTemplate(view=setParameterByName_12, viewTemplate=code_block_25.out3)
setViewTemplate_5 = archilab.Revit.Views.Views.SetViewTemplate(view=setParameterByName_15, viewTemplate=code_block_25.out4)
list_create_4 = List.Create(item0=setParameterByName_18, item1=python_script_2)
setViewTemplate_6 = archilab.Revit.Views.Views.SetViewTemplate(view=list_create_4, viewTemplate=code_block_25.out5)
setViewTemplate_7 = archilab.Revit.Views.Views.SetViewTemplate(view=setParameterByName_25, viewTemplate=code_block_25.out6)

# group: Set Viewport
list_create_5 = List.Create(item0=setViewTemplate, item1=setViewTemplate_2, item2=setViewTemplate_3, item3=setViewTemplate_4, item4=setViewTemplate_5)
transpose = List.Transpose(lists=list_create_5, lacing=Longest)
ʳʰʸᵗʰᵐ_view_viewport = Rhythm.Revit.Views.View.Viewport(view=transpose)
flatten_9 = List.Flatten(list=ʳʰʸᵗʰᵐ_view_viewport)
element_changetype = Custom[Element ChangeType](element=flatten_9, elementType=code_block_6.out0)  # package Genius Loci; Changes the type of the given instance to the specified type.
transpose_2 = List.Transpose(lists=setViewTemplate_6, lacing=Longest)
ʳʰʸᵗʰᵐ_view_viewport_2 = Rhythm.Revit.Views.View.Viewport(view=transpose_2)
flatten_10 = List.Flatten(list=ʳʰʸᵗʰᵐ_view_viewport_2)
element_changetype_2 = Custom[Element ChangeType](element=flatten_10, elementType=code_block_6.out1)

# group: Views And Viewport Location
ʳʰʸᵗʰᵐ_view_viewport_3 = Rhythm.Revit.Views.View.Viewport(view=setViewTemplate)
code_block_77 = CodeBlock { 150; 450; }
byCoordinates = Point.ByCoordinates(x=code_block_77.out0, y=code_block_77.out1)
ʳʰʸᵗʰᵐ_viewport_setboxcenter = Rhythm.Revit.Elements.Viewport.SetBoxCenter(viewport=ʳʰʸᵗʰᵐ_view_viewport_3, point=byCoordinates)
ʳʰʸᵗʰᵐ_view_viewport_4 = Rhythm.Revit.Views.View.Viewport(view=setViewTemplate_2)
code_block_78 = CodeBlock { 300; 279; }
byCoordinates_2 = Point.ByCoordinates(x=code_block_78.out0, y=code_block_78.out1)
ʳʰʸᵗʰᵐ_viewport_setboxcenter_2 = Rhythm.Revit.Elements.Viewport.SetBoxCenter(viewport=ʳʰʸᵗʰᵐ_view_viewport_4, point=byCoordinates_2)
ʳʰʸᵗʰᵐ_view_viewport_5 = Rhythm.Revit.Views.View.Viewport(view=setViewTemplate_3)
code_block_79 = CodeBlock { 560; 279; }
byCoordinates_3 = Point.ByCoordinates(x=code_block_79.out0, y=code_block_79.out1)
ʳʰʸᵗʰᵐ_viewport_setboxcenter_3 = Rhythm.Revit.Elements.Viewport.SetBoxCenter(viewport=ʳʰʸᵗʰᵐ_view_viewport_5, point=byCoordinates_3)
ʳʰʸᵗʰᵐ_view_viewport_6 = Rhythm.Revit.Views.View.Viewport(view=setViewTemplate_4)
code_block_80 = CodeBlock { 0; 7; }
byCoordinates_4 = Point.ByCoordinates(x=code_block_80.out0, y=code_block_80.out1)
ʳʰʸᵗʰᵐ_viewport_setboxcenter_4 = Rhythm.Revit.Elements.Viewport.SetBoxCenter(viewport=ʳʰʸᵗʰᵐ_view_viewport_6, point=byCoordinates_4)
ʳʰʸᵗʰᵐ_view_viewport_7 = Rhythm.Revit.Views.View.Viewport(view=setViewTemplate_5)
code_block_81 = CodeBlock { 0; 80; }
byCoordinates_5 = Point.ByCoordinates(x=code_block_81.out0, y=code_block_81.out1)
ʳʰʸᵗʰᵐ_viewport_setboxcenter_5 = Rhythm.Revit.Elements.Viewport.SetBoxCenter(viewport=ʳʰʸᵗʰᵐ_view_viewport_7, point=byCoordinates_5)
code_block_82 = CodeBlock(A=setViewTemplate_6) { A[0]; A[1]; }
ʳʰʸᵗʰᵐ_view_viewport_8 = Rhythm.Revit.Views.View.Viewport(view=code_block_82.out0)
code_block_83 = CodeBlock { 330; 50; }
byCoordinates_6 = Point.ByCoordinates(x=code_block_83.out0, y=code_block_83.out1)
ʳʰʸᵗʰᵐ_viewport_setboxcenter_6 = Rhythm.Revit.Elements.Viewport.SetBoxCenter(viewport=ʳʰʸᵗʰᵐ_view_viewport_8, point=byCoordinates_6)
ʳʰʸᵗʰᵐ_view_viewport_9 = Rhythm.Revit.Views.View.Viewport(view=code_block_82.out1)
code_block_84 = CodeBlock { 0; 1540; }
byCoordinates_7 = Point.ByCoordinates(x=code_block_84.out0, y=code_block_84.out1)
ʳʰʸᵗʰᵐ_viewport_setboxcenter_7 = Rhythm.Revit.Elements.Viewport.SetBoxCenter(viewport=ʳʰʸᵗʰᵐ_view_viewport_9, point=byCoordinates_7)
list_create_6 = List.Create(item0=ʳʰʸᵗʰᵐ_view_viewport_3, item1=ʳʰʸᵗʰᵐ_view_viewport_4, item2=ʳʰʸᵗʰᵐ_view_viewport_5, item3=ʳʰʸᵗʰᵐ_view_viewport_6, item4=ʳʰʸᵗʰᵐ_view_viewport_7, item5=ʳʰʸᵗʰᵐ_view_viewport_8, item6=ʳʰʸᵗʰᵐ_view_viewport_9)
end = Revit.Transaction.Transaction.End(input=list_create_6)
flatten_11 = List.Flatten(list=end)
code_block_85 = CodeBlock { 10; -20; }
byCoordinates_8 = Point.ByCoordinates(x=code_block_85.out0, y=code_block_85.out1)
ʳʰʸᵗʰᵐ_viewport = Rhythm.Revit.Elements.Viewport.SetViewTitleLocation(viewport=flatten_11, location=byCoordinates_8)
schedules = Sheet.Schedules(sheet=assemblyViews.Sheet_s)
code_block_86 = CodeBlock { 600; 20; }
byCoordinates_9 = Point.ByCoordinates(x=code_block_86.out0, y=code_block_86.out1)
setLocation = ScheduleOnSheet.SetLocation(scheduleOnSheet=schedules, point=byCoordinates_9)
code_block_87 = CodeBlock { 0.2; }
ʳʰʸᵗʰᵐ_viewport_2 = Rhythm.Revit.Elements.Viewport.SetViewTitleLength(viewport=ʳʰʸᵗʰᵐ_view_viewport_3, length=code_block_87)
code_block_88 = CodeBlock { 0.1; }
ʳʰʸᵗʰᵐ_viewport_3 = Rhythm.Revit.Elements.Viewport.SetViewTitleLength(viewport=ʳʰʸᵗʰᵐ_view_viewport_4, length=code_block_88)
list_create_7 = List.Create(item0=ʳʰʸᵗʰᵐ_view_viewport_7, item1=ʳʰʸᵗʰᵐ_view_viewport_6, item2=ʳʰʸᵗʰᵐ_view_viewport_5)
flatten_12 = List.Flatten(list=list_create_7)
code_block_89 = CodeBlock { 0.065; }
ʳʰʸᵗʰᵐ_viewport_4 = Rhythm.Revit.Elements.Viewport.SetViewTitleLength(viewport=flatten_12, length=code_block_89)
list_create_8 = List.Create(item0=ʳʰʸᵗʰᵐ_view_viewport_8, item1=ʳʰʸᵗʰᵐ_view_viewport_9)
code_block_90 = CodeBlock { 0.1; }
ʳʰʸᵗʰᵐ_viewport_5 = Rhythm.Revit.Elements.Viewport.SetViewTitleLength(viewport=list_create_8, length=code_block_90)

# group: Sheets Details
now = DateTime.Now()
code_block_91 = CodeBlock { "dd-MM-yyyy"; }
format = DateTime.Format(dateTime=now, format=code_block_91)
code_block_92 = CodeBlock { "REVISION AND SHEET DETAILS"; 120; 400; 600; "UPDATE"; }
code_block_93 = CodeBlock()
# ---------- code_block_93.designscript (11 lines) ----------
"Description:";
"IssuedBy:";
"IssuedTo:";
"Drawn By";
"Approved By";
"Checked By";
"Designed By";
"Revision";
"BPA";
"ANU/AKM";
"ISSUED TO MEP";
# ----------------------------------------
textbox_data_2 = Custom[TextBox Data](InputName=code_block_93.out0, DefaultText=code_block_93.out10)
textbox_data_3 = Custom[TextBox Data](InputName=code_block_93.out1, DefaultText=code_block_93.out8)
textbox_data_4 = Custom[TextBox Data](InputName=code_block_93.out2, DefaultText=code_block_93.out9)
boolean_input = Custom[Boolean input](InputName=code_block_93.out7)  # package Data-Shapes; Creates a boolean input for UI.MultipleInputForm ++ . Check out www.data-shapes.net for more infos!
list_create_9 = List.Create(item0=textbox_data_2, item1=textbox_data_3, item2=textbox_data_4, item3=boolean_input)
textbox_data_5 = Custom[TextBox Data](InputName=code_block_93.out3, DefaultText=code_block_93.out8)
textbox_data_6 = Custom[TextBox Data](InputName=code_block_93.out4)
textbox_data_7 = Custom[TextBox Data](InputName=code_block_93.out5, DefaultText=code_block_93.out9)
textbox_data_8 = Custom[TextBox Data](InputName=code_block_93.out6)
list_create_10 = List.Create(item0=textbox_data_5, item1=textbox_data_6, item2=textbox_data_7, item3=textbox_data_8)
list_create_11 = List.Create(item0=list_create_9, item1=list_create_10)
boolean_6 = BoolSelector(true)
multipleinputform_3 = Custom[MultipleInputForm ++](Description_optional=code_block_92.out0, ButtonText_optional=code_block_92.out4, Inputs=list_create_11, Toggle=boolean_6, MaxHeight_optional=code_block_92.out3, Width_optional=code_block_92.out2, LabelWidth_optional=code_block_92.out1)
code_block_94 = CodeBlock(a=multipleinputform_3.User_Inputs) { a[0]; }
code_block_95 = CodeBlock(a=code_block_94) { a[0]; a[1]; a[2]; a[3]; }
create = archilab.Revit.Elements.Revisions.Create(revisionDate=format, description=code_block_95.out0, issuedBy=code_block_95.out1, issuedTo=code_block_95.out2)
sheets_revisionsadd = Custom[© Sheets.RevisionsAdd](sheets=assemblyViews.Sheet_s, revisions=create, runMe=code_block_95.out3)  # package Crumple; Given a list of sheets, attempt to add the given revisions to each of those sheets.
code_block_96 = CodeBlock { "Drawn By"; "Approved By"; "Checked By"; "Designed By"; "Sheet Issue Date"; }
code_block_97 = CodeBlock(a=multipleinputform_3.User_Inputs) { a[1]; }
code_block_98 = CodeBlock(a=code_block_97) { a[0]; a[1]; a[2]; a[3]; }
setParameterByName_26 = Element.SetParameterByName(element=assemblyViews.Sheet_s, parameterName=code_block_96.out0, value=code_block_98.out0)
setParameterByName_27 = Element.SetParameterByName(element=assemblyViews.Sheet_s, parameterName=code_block_96.out1, value=code_block_98.out1)
setParameterByName_28 = Element.SetParameterByName(element=assemblyViews.Sheet_s, parameterName=code_block_96.out2, value=code_block_98.out2)
setParameterByName_29 = Element.SetParameterByName(element=assemblyViews.Sheet_s, parameterName=code_block_96.out3, value=code_block_98.out3)
now_2 = DateTime.Now()
code_block_99 = CodeBlock { "dd-MM-yyyy"; }
format_2 = DateTime.Format(dateTime=now_2, format=code_block_99)
setParameterByName_30 = Element.SetParameterByName(element=assemblyViews.Sheet_s, parameterName=code_block_96.out4, value=format_2)

ʳʰʸᵗʰᵐ_view_viewport_10 = Rhythm.Revit.Views.View.Viewport(view=python_script_2)
code_block_100 = CodeBlock { 600; 20; }
byCoordinates_10 = Point.ByCoordinates(x=code_block_100.out0, y=code_block_100.out1)
ʳʰʸᵗʰᵐ_viewport_setboxcenter_8 = Rhythm.Revit.Elements.Viewport.SetBoxCenter(viewport=ʳʰʸᵗʰᵐ_view_viewport_10, point=byCoordinates_10)  # frozen
