# Dynamo graph script.dyn (Dynamo 3.3.0.6316)
# packages: Data-Shapes 2025.3.119, Clockwork for Dynamo 3.x 3.3.0, Ampersand 2017.2.2, Genius Loci 2023.7.13

# group: Collect Categorys and Views
code_block = CodeBlock { "SELECT CATEGORY & VIEWS"; "SET"; 600; 400; 150; "CANCEL"; }
code_block_2 = CodeBlock { "Select category"; "Select views"; }
categories_listall = Custom[[&] Categories.ListAll]()  # package Ampersand; List of all Revit Categories
dropdown_data = Custom[DropDown Data](InputName=code_block_2.out0, Keys=categories_listall.names, Values=categories_listall.categories)  # package Data-Shapes; Create data for DropDown input in UI.MultiInputForm ++ . Check out www.data-shapes.net for more infos.
collector_of_views = Custom[Collector of Views]()  # package Genius Loci; Collects all views in the active or given document.
name = Element.Name(element=collector_of_views.View)
dropdown_data_2 = Custom[DropDown Data](InputName=code_block_2.out1, Keys=name, Values=collector_of_views.View)
list_create = List.Create(item0=dropdown_data, item1=dropdown_data_2)
boolean = BoolSelector(true)
multipleinputform = Custom[MultipleInputForm ++](Description_optional=code_block.out0, ButtonText_optional=code_block.out1, Inputs=list_create, Toggle=boolean, CancelButtonText_optional=code_block.out5, MaxHeight_optional=code_block.out2, Width_optional=code_block.out3, LabelWidth_optional=code_block.out4)  # package Data-Shapes; Create a form with multiple inputs. see www.data-shapes.net for tutorials and infos!

# group: Filter with Comments
code_block_3 = CodeBlock(a=multipleinputform.User_Inputs) { a[0]; a[1]; }
all_elements_of_category_in_view = ElementsOfCategoryInView(Category=code_block_3.out0, View=code_block_3.out1)
code_block_4 = CodeBlock { "Comments"; }
getParameterValueByName = Element.GetParameterValueByName(element=all_elements_of_category_in_view, parameterName=code_block_4)
code_block_5 = CodeBlock { i=null; }
not_ = Not(x=code_block_5)
eq = getParameterValueByName == not_
filterByBoolMask = List.FilterByBoolMask(list=all_elements_of_category_in_view, mask=eq)
code_block_6 = CodeBlock { "Comments"; }
getParameterValueByName_2 = Element.GetParameterValueByName(element=filterByBoolMask.in, parameterName=code_block_6)

# group: UI
code_block_7 = CodeBlock { "CREATE ASSEMBLY"; "CREATE"; 600; 400; 150; "CANCEL"; }
code_block_8 = CodeBlock { "SELECT WALLS"; 300; true; false; }
listview_data = Custom[Listview Data](InputName=code_block_8.out0, Keys=getParameterValueByName_2, Values=filterByBoolMask.in, Height_optionnal=code_block_8.out1, SortItems_optionnal=code_block_8.out2, ShowId_optionnal=code_block_8.out3)  # package Data-Shapes; Create data for ListView input in UI.MultiInputForm ++ . Check out www.data-shapes.net for more infos.
boolean_2 = BoolSelector(true)
multipleinputform_2 = Custom[MultipleInputForm ++](Description_optional=code_block_7.out0, ButtonText_optional=code_block_7.out1, Inputs=listview_data, Toggle=boolean_2, CancelButtonText_optional=code_block_7.out5, MaxHeight_optional=code_block_7.out2, Width_optional=code_block_7.out3, LabelWidth_optional=code_block_7.out4)

# group: Assembly Name
code_block_9 = CodeBlock { "Comments"; }
getParameterValueByName_3 = Element.GetParameterValueByName(element=multipleinputform_2.User_Inputs, parameterName=code_block_9)
turnIntoList = Custom[TurnIntoList](unknownItem=getParameterValueByName_3)  # package Clockwork for Dynamo 3.x; Turns an element (or a nested list) into a flat list

# group: Select Associated Elements
flatten = List.Flatten(list=multipleinputform_2.User_Inputs)
python_script = Python(IN[0]=flatten)  # IronPython2
# ---------- python_script.python (88 lines) ----------
import clr
clr.AddReference("RevitAPI")
from Autodesk.Revit.DB import *

clr.AddReference("RevitServices")
from RevitServices.Persistence import DocumentManager

doc = DocumentManager.Instance.CurrentDBDocument
walls = UnwrapElement(IN[0])

def get_solid(element):
    opt = Options()
    opt.ComputeReferences = True
    opt.DetailLevel = ViewDetailLevel.Fine
    geo = element.get_Geometry(opt)
    solids = [g for g in geo if isinstance(g, Solid) and g.Volume > 0]
    return solids[0] if solids else None

all_related = []

for wall in walls:
    related = set()

    wall_solid = get_solid(wall)
    if wall_solid is None:
        all_related.append([])
        continue

    # Collect all non-types
    collector = FilteredElementCollector(doc).WhereElementIsNotElementType()

    for el in collector:
        if el.Id == wall.Id:
            continue

        # -----------------------------
        # 1️⃣ Host-based families (doors, windows, hosted fittings)
        # -----------------------------
        try:
            if el.Host != None and el.Host.Id == wall.Id:
                related.add(el)
                continue
        except:
            pass

        # -----------------------------
        # 2️⃣ Face-based families
        # -----------------------------
        try:
            if hasattr(el, "HostFace") and el.HostFace is not None:
                host_ref = el.HostFace
                h_el = doc.GetElement(host_ref.ElementId)
                if h_el and h_el.Id == wall.Id:
                    related.add(el)
                    continue
        except:
            pass

        # -----------------------------
        # 3️⃣ Elements cutting the wall
        # -----------------------------
        try:
            cutters = wall.CutOuts()
            if cutters and el.Id in cutters:
                related.add(el)
                continue
        except:
            pass

        # -----------------------------
        # 4️⃣ Geometry intersection
        # -----------------------------
        try:
            el_solid = get_solid(el)
            if el_solid:
                result = BooleanOperationsUtils.ExecuteBooleanOperation(
                    wall_solid,
                    el_solid,
                    BooleanOperationsType.Intersect
                )
                if result and result.Volume > 0:
                    related.add(el)
        except:
            pass

    all_related.append(list(related))

OUT = all_related
# ----------------------------------------
clean = List.Clean(list=python_script)
code_block_10 = CodeBlock { 1; }
flatten_2 = List.Flatten(list=clean@L2, amount=code_block_10)
watch = Watch(flatten_2)
addItemToFront = List.AddItemToFront(item=flatten@@L1, list=watch@L2)
code_block_11 = CodeBlock { 1; }
flatten_3 = List.Flatten(list=addItemToFront@L2, amount=code_block_11)

# group: Assembly.FromElements node
list_create_2 = List.Create(item0=flatten_3)
transpose = List.Transpose(lists=list_create_2@L2)
fromElements = Custom[Assembly.FromElements](elements=transpose, assemblyName=turnIntoList)  # package Clockwork for Dynamo 3.x; Creates an assembly from a list of elements
returnListOrSingleValue = Custom[ReturnListOrSingleValue](unknownItem=turnIntoList, seq=fromElements)  # package Clockwork for Dynamo 3.x; If the unknown item is not a list but rather a single item, only the first item of the list (input "seq") will be returned.
code_block_12 = CodeBlock(assemblyInstance=returnListOrSingleValue) { assemblyInstance; }
