# Dynamo graph script.dyn "A_Orgin" (Dynamo 3.3.0.6316)
# packages: Clockwork for Dynamo 3.x 3.3.0, Data-Shapes 2025.3.119

# group: Collect Assembies
code_block = CodeBlock { "SELECT ASSEMBLY"; 350; false; }
categories = Categories("OST_Assemblies")
all_elements_of_category = ElementsOfCategory(Category=categories)
name = Element.Name(element=all_elements_of_category)
listview_data = Custom[Listview Data](InputName=code_block.out0, Keys=name, Values=all_elements_of_category, Height_optionnal=code_block.out1, ShowId_optionnal=code_block.out2)  # package Data-Shapes; Create data for ListView input in UI.MultiInputForm ++ . Check out www.data-shapes.net for more infos.

# group: Filter Family Name
code_block_2 = CodeBlock { "Erection Mark"; "TYPE FAMILY NAME"; }
textbox_data = Custom[TextBox Data](InputName=code_block_2.out1, DefaultText=code_block_2.out0)  # package Data-Shapes; Create Data for TextBox input in UI.MultipleInputForm ++ . Check out www.data-shapes.net for more informations

# group: UI
code_block_3 = CodeBlock { "ROTATE ASSEMBLY ORIGIN"; 800; 450; false; "UPDATE"; "CANCEL"; 150; }
list_create = List.Create(item0=listview_data, item1=textbox_data)
boolean = BoolSelector(true)
multipleinputform = Custom[MultipleInputForm ++](Description_optional=code_block_3.out0, ButtonText_optional=code_block_3.out4, Inputs=list_create, Toggle=boolean, CancelButtonText_optional=code_block_3.out5, MaxHeight_optional=code_block_3.out1, Width_optional=code_block_3.out2, LabelWidth_optional=code_block_3.out6)  # package Data-Shapes; Create a form with multiple inputs. see www.data-shapes.net for tutorials and infos!

# group: Filter Family Type
code_block_4 = CodeBlock(out=multipleinputform.User_Inputs) { ass = out[0]; ftype = out[1]; }
flatten = List.Flatten(list=code_block_4.ass)
members = Custom[Assembly.Members](assembly=flatten)  # package Clockwork for Dynamo 3.x; Retrieves the members of an assembly
name_2 = Element.Name(element=members)
contains = String.Contains(string=name_2, searchFor=code_block_4.ftype)
filterByBoolMask = List.FilterByBoolMask(list=members, mask=contains)
flatten_2 = List.Flatten(list=filterByBoolMask.in)

# group: Get Angle
location = FamilyInstance.Location(familyInstance=flatten_2)
handOrientation = Custom[FamilyInstance.HandOrientation](familyInstance=flatten_2)  # package Clockwork for Dynamo 3.x; Gets the hand orientation of a hosted object (e.g. a window or a door)
code_block_5 = CodeBlock { 1500; }
byStartPointDirectionLength = Line.ByStartPointDirectionLength(startPoint=location, direction=handOrientation, length=code_block_5)
endPoint = Curve.EndPoint(curve=byStartPointDirectionLength)
byTwoPoints = Vector.ByTwoPoints(start=location, end=endPoint)
XAxis = Vector.XAxis()
ZAxis = Vector.ZAxis()
reverse = Vector.Reverse(vector=ZAxis)
angleAboutAxis = Vector.AngleAboutAxis(vector=byTwoPoints, otherVector=XAxis, rotationAxis=reverse)
code_block_6 = CodeBlock { 3; }
round = Math.Round(number=angleAboutAxis, digits=code_block_6)

# group: Assembly Origin Rotation
ZAxis_2 = Vector.ZAxis()
end = Revit.Transaction.Transaction.End(input=round)
python_script = Python(IN[0]=flatten, IN[1]=ZAxis_2, IN[2]=end)  # IronPython2
# ---------- python_script.python (86 lines) ----------
import clr
import math

clr.AddReference("ProtoGeometry")
from Autodesk.DesignScript.Geometry import *

clr.AddReference("RevitServices")
from RevitServices.Persistence import DocumentManager

doc = DocumentManager.Instance.CurrentDBDocument

clr.AddReference("RevitNodes")
import Revit
clr.ImportExtensions(Revit.Elements)
clr.ImportExtensions(Revit.GeometryConversion)

clr.AddReference("RevitAPI")
from Autodesk.Revit.DB import *

def tolist(obj1):
    if hasattr(obj1, "__iter__"): 
        return obj1
    else: 
        return [obj1]

# INPUTS
elems = tolist(UnwrapElement(IN[0]))
axis_input = IN[1]
rot_input = IN[2]

axis = tolist(axis_input)
rot = tolist(rot_input)

# Replicate single values
if len(axis) == 1 and len(elems) > 1:
    axis = axis * len(elems)

if len(rot) == 1 and len(elems) > 1:
    rot = rot * len(elems)

result = []
status = []          # NEW → success indicator list
success_count = 0

# Process each assembly with its own transaction
for i, (e, a, r) in enumerate(zip(elems, axis, rot)):
    
    t = Transaction(doc, "Rotate Assembly " + str(i+1))
    t.Start()
    
    try:
        trans = e.GetTransform()
        origin = trans.Origin
        
        if hasattr(a, 'ToXyz'):
            axis_xyz = a.ToXyz()
        else:
            axis_xyz = a
        
        axis_normalized = axis_xyz.Normalize()
        
        rotation_transform = Transform.CreateRotationAtPoint(
            axis_normalized,
            math.radians(r),
            origin
        )
        
        new_transform = rotation_transform.Multiply(trans)
        e.SetTransform(new_transform)
        
        t.Commit()
        
        success_count += 1
        result.append("✓ Assembly " + str(i+1) + ": Rotated " + str(r) + "°")
        status.append(1)    # NEW → success
        
    except Exception as ex:
        t.RollBack()
        result.append("✗ Assembly " + str(i+1) + ": Error - " + str(ex))
        status.append(0)    # NEW → failure

result.append("---")
result.append("Total: " + str(success_count) + "/" + str(len(elems)) + " assemblies rotated successfully")

# OUTPUTS
OUT = result, status
# ----------------------------------------
