# Dynamo graph PDF & DWG Sheets Export_script.dyn (Dynamo 3.3.0.6316)
# packages: Crumple 2024.4.3, Data-Shapes 2025.3.119, Clockwork for Dynamo 3.x 3.3.0

# group: Collecting sheets
code_block = CodeBlock { "Select Sheets"; 400; false; }
categories = Categories("OST_Sheets")
all_elements_of_category = ElementsOfCategory(Category=categories)
sheetNumber = Sheet.SheetNumber(sheet=all_elements_of_category)
boolean = BoolSelector(false)
listview_data = Custom[Listview Data](InputName=code_block.out0, Keys=sheetNumber, Values=all_elements_of_category, Height_optionnal=code_block.out1, ShowId_optionnal=boolean)  # package Data-Shapes; Create data for ListView input in UI.MultiInputForm ++ . Check out www.data-shapes.net for more infos.

# group: Export Setup
code_block_2 = CodeBlock { "CAD Export Path"; "PDF Export Path"; "CAD Files"; "Select DWG Setting"; }
directorypath_data = Custom[DirectoryPath Data](InputName=code_block_2.out0)  # package Data-Shapes; Creates a DirectoryPath input for UI.MultipleInputForm ++ . Check out www.data-shapes.net for more infos!
directorypath_data_2 = Custom[DirectoryPath Data](InputName=code_block_2.out1)
boolean_input = Custom[Boolean input](InputName=code_block_2.out2)  # package Data-Shapes; Creates a boolean input for UI.MultipleInputForm ++ . Check out www.data-shapes.net for more infos!
collect_baseexportoptions = Custom[© Collect.BaseExportOptions]()  # package Crumple; Collect the DWG/DXF/DGN options from the provided document if any, returning their name.
dropdown_data = Custom[DropDown Data](InputName=code_block_2.out3, Keys=collect_baseexportoptions, Values=collect_baseexportoptions)  # package Data-Shapes; Create data for DropDown input in UI.MultiInputForm ++ . Check out www.data-shapes.net for more infos.

# group: Process
code_block_3 = CodeBlock { "Export CAD And PDF Files"; "Sheets"; 1000; "Cancelled"; "Proceed"; 500; }
list_create = List.Create(item0=listview_data, item1=directorypath_data, item2=directorypath_data_2, item3=boolean_input, item4=dropdown_data)
boolean_2 = BoolSelector(true)
multipleinputform = Custom[MultipleInputForm ++](Description_optional=code_block_3.out0, Logo_optional=code_block_3.out1, ButtonText_optional=code_block_3.out4, Inputs=list_create, Toggle=boolean_2, CancelButtonText_optional=code_block_3.out3, MaxHeight_optional=code_block_3.out2, Width_optional=code_block_3.out5)  # package Data-Shapes; Create a form with multiple inputs. see www.data-shapes.net for tutorials and infos!
code_block_4 = CodeBlock(a=multipleinputform.User_Inputs) { a[0]; a[1]; a[2]; a[3]; a[4]; }

# group: Exporting Files
projectInfo = Custom[Document.ProjectInfo]()  # package Clockwork for Dynamo 3.x; Gets the project information.
code_block_5 = CodeBlock { "-"; }
add = projectInfo.Number + code_block_5
sheetNumber_2 = Sheet.SheetNumber(sheet=code_block_4.out0)
add_2 = add + sheetNumber_2
boolean_3 = BoolSelector(false)
revit_exportoptionsdwg = Custom[© Revit.ExportOptionsDwg](settingsName=code_block_4.out4, mergeViewsAsXrefs=boolean_3)  # package Crumple; Creates a DWG export options object, or retrieves one with the given name if found in the document.
revit_exporttodwg = Custom[© Revit.ExportToDwg](directoryPath=code_block_4.out1, viewsOrSheets=code_block_4.out0, fileNames=add_2, dwgExportOptions=revit_exportoptionsdwg.dwgExportOptions, runMe=code_block_4.out3)  # package Crumple; Given a list of views and/or sheets as well as various related settings, attempts to export them to DWG using the provided settings.
revit_exportoptionspdf = Custom[© Revit.ExportOptionsPdf]()  # package Crumple; Provides a list of options to be used in conjunction with the ExportPDF node. Works in Revit 2022 and later.
revit_exporttopdf = Custom[© Revit.ExportToPdf](directoryPath=code_block_4.out2, sheets=code_block_4.out0, fileNames=add_2, options=revit_exportoptionspdf)  # package Crumple; Given a list of sheets, names, directory and export options this node will batch export PDF files. Requires Revit 2022 or higher to work.
